# Dynamo graph Single Surface Tessellation Script.dyn "lesson dynamo" (Dynamo 2.0.0.4654)

# group: Controls
select_from_alias = SelectNode()
# note: Select a single surface
number_of_lines = IntegerSlider(19, range=2..30 step 1)
number_of_triangles_per_line = IntegerSlider(9, range=2..30 step 1)

isodirection = IntegerSlider(1, range=0..1 step 1)
code_block = CodeBlock(numberOfLines=number_of_lines) { 0..1..#numberOfLines; }
getIsoline = Surface.GetIsoline(surface=select_from_alias, isoDirection=isodirection, parameter=code_block)
code_block_2 = CodeBlock(numberOfTrianglesPerLine=number_of_triangles_per_line) { 0..1..#numberOfTrianglesPerLine; }
pointAtParameter = Curve.PointAtParameter(curve=getIsoline, param=code_block_2, lacing=CrossProduct)
code_block_3 = CodeBlock { 1; }
dropItems = List.DropItems(list=pointAtParameter@L3, amount=code_block_3)
code_block_4 = CodeBlock { 0; }
code_block_5 = CodeBlock { 1; }
sublists = List.Sublists(list=dropItems@L2, ranges=code_block_4, offset=code_block_5)

# group: top one point of triangles
code_block_6 = CodeBlock { -1; }
dropItems_2 = List.DropItems(list=sublists@L3, amount=code_block_6)

code_block_7 = CodeBlock { [0,1]; }
code_block_8 = CodeBlock { 1; }
sublists_2 = List.Sublists(list=pointAtParameter@L2, ranges=code_block_7, offset=code_block_8)

# group: bottom two points of triangles
code_block_9 = CodeBlock { -1; }
dropItems_3 = List.DropItems(list=sublists_2@L3, amount=code_block_9)

# group: set one
addItemToFront = List.AddItemToFront(item=dropItems_2@L1, list=dropItems_3@L2)
byPoints = Polygon.ByPoints(points=addItemToFront)
byPatch = Surface.ByPatch(closedCurve=byPoints)

code_block_10 = CodeBlock { 1; }
dropItems_4 = List.DropItems(list=pointAtParameter@L2, amount=code_block_10)
code_block_11 = CodeBlock { -1; }
dropItems_5 = List.DropItems(list=dropItems_4, amount=code_block_11)

# group: bottom one point of each triangle
sublists_3 = List.Sublists(list=dropItems_5@L2, ranges=code_block_4, offset=code_block_5)

code_block_12 = CodeBlock { 1; }
dropItems_6 = List.DropItems(list=pointAtParameter, amount=code_block_12)
code_block_13 = CodeBlock { 0..1; 1; }
sublists_4 = List.Sublists(list=dropItems_6@L2, ranges=code_block_13.out0, offset=code_block_13.out1)

# group: top two points of each triangle
code_block_14 = CodeBlock { -1; }
dropItems_7 = List.DropItems(list=sublists_4@L3, amount=code_block_14)

# group: set two
addItemToFront_2 = List.AddItemToFront(item=sublists_3@L1, list=dropItems_7@L2)
byPoints_2 = Polygon.ByPoints(points=addItemToFront_2)
byPatch_2 = Surface.ByPatch(closedCurve=byPoints_2)

list_create = List.Create(item0=byPatch, item1=byPatch_2)
bake_to_alias = BakeNode(list_create)
