# Dynamo graph Trimming and Attractor Curve.dyn "Dynamo tutorial" (Dynamo 2.0.1.5354)

# group: Send the surface
select_from_alias = SelectNode()

# group: Controls
margin_control = DoubleSlider(0.03, range=0..0.5 step 0.001)
u_points = IntegerSlider(30, range=4..30 step 1)
v_points = IntegerSlider(25, range=4..25 step 1)
new_min = CodeBlock { 2; }
new_max = CodeBlock { 15; }

code_block = CodeBlock(margin=margin_control, slider=u_points) { 0+margin..1-margin..#slider; }
code_block_2 = CodeBlock(margin=margin_control, slider=v_points) { 0+margin..1-margin..#slider; }
pointAtParameter = Surface.PointAtParameter(surface=select_from_alias, u=code_block, v=code_block_2, lacing=CrossProduct)

# group: Send the nurbs curve
select_from_alias_2 = SelectNode()

ZAxis = Vector.ZAxis()
projectInputOnto = Surface.ProjectInputOnto(surface=select_from_alias, geometryToProject=select_from_alias_2, projectionDirection=ZAxis)
code_block_3 = CodeBlock { 0..1..#20; }
pointAtParameter_2 = Curve.PointAtParameter(curve=projectInputOnto, param=code_block_3, lacing=CrossProduct)
distanceTo = Geometry.DistanceTo(geometry=pointAtParameter@L1, other=pointAtParameter_2, lacing=CrossProduct)
code_block_4 = CodeBlock { 1; }
flatten = List.Flatten(list=distanceTo, amt=code_block_4)
minimumItem = List.MinimumItem(list=flatten)
remapRange = Math.RemapRange(numbers=minimumItem, newMin=new_min, newMax=new_max)
chop = List.Chop(list=remapRange, lengths=v_points)
normalAtPoint = Surface.NormalAtPoint(surface=select_from_alias, point=pointAtParameter)
byCenterPointRadiusNormal = Circle.ByCenterPointRadiusNormal(centerPoint=pointAtParameter, radius=chop, normal=normalAtPoint)
byPatch = Surface.ByPatch(closedCurve=byCenterPointRadiusNormal)
code_block_5 = CodeBlock { 25; }
thicken = Surface.Thicken(surface=byPatch, thickness=code_block_5)
flatten_2 = List.Flatten(list=thicken)
byUnion = Solid.ByUnion(solids=flatten_2)
subtractFrom = Surface.SubtractFrom(surface=select_from_alias, trimmingEntity=byUnion)
bake_to_alias = BakeNode(subtractFrom)
